% Simulink data dictionary raceline.sldd

Raceline = struct(
  s_m=[0; 1.4987545; 2.9975079; 4.49626; 5.9950107; 7.49376; 8.9925078; 10.491254; 11.9899988; 13.488742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 7493.036],
  x_m=[296.9719832; 295.8222869; 294.6757167; 293.5322786; 292.391979; 291.2548237; 290.1208186; 288.9899695; 287.8622821; 286.7377622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 0],
  y_m=[690.5206764; 689.5591871; 688.593974; 687.6250543; 686.6524451; 685.6761638; 684.6962274; 683.712653; 682.7254574; 681.7346576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 0],
  psi_rad=[2.2656568; 2.268904; 2.272145; 2.2753798; 2.2786086; 2.2818311; 2.2850477; 2.2882582; 2.2914626; 2.2946611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 0],
  kappa_radpm=[0.0021687; 0.0021632; 0.0021632; 0.0021577; 0.0021522; 0.0021468; 0.0021468; 0.0021414; 0.0021361; 0.0021308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 0],
  vx_mps=[83; 83; 83; 83; 83; 83; 83; 83; 83; 83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 0],
  ax_mps2=[0; 0; 0; 0; 0; 0; 0; 0; 0; 0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 0],
  ValidPointCnt=1637,
  s_m_end=2452.2116862,
  banking_rad=[-0.1571; -0.1571; -0.1571; -0.1571; -0.1571; -0.1571; -0.1571; -0.1571; -0.1571; -0.1571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 0])

x0_vehiclepose_stm = [296.9719832 690.5206764 2.2656568]
x0_vehiclepose_dtm = [296.9719832 -690.5206764 0 0 0 2.446732]
x0_vehiclepos_start_veh1 = [296.9719832 690.5206764 2.2656568]
x0_vehiclepos_park_veh1 = [287.3491 702.0272 3.051055]
x0_vehiclepos_start_veh2 = [308.6394187 699.9269668 2.2328986]
x0_vehiclepos_park_veh2 = [292.7188 706.5179 3.051055]
x0_vehiclepos_start_veh3 = [320.6078091 708.9471935 2.2005031]
x0_vehiclepos_park_veh3 = [298.0885 711.0086 3.051055]
x0_vehiclepos_start_veh4 = [332.8591374 717.5791398 2.1687764]
x0_vehiclepos_park_veh4 = [303.4582 715.4992 3.051055]
x0_vehiclepos_start_veh5 = [345.3755815 725.8222677 2.1377146]
x0_vehiclepos_park_veh5 = [308.8279 719.9899 3.051055]
x0_vehiclepos_start_veh6 = [358.139265 733.6785248 2.1075435]
x0_vehiclepos_park_veh6 = [314.1976 724.4806 3.051055]
x0_vehiclepos_start_veh7 = [371.1314811 741.1529092 2.0783242]
x0_vehiclepos_park_veh7 = [319.5674 728.9713 3.051055]
x0_vehiclepos_start_veh8 = [384.3341714 748.2511972 2.0500324]
x0_vehiclepos_park_veh8 = [324.9371 733.462 3.051055]
x0_vehiclepos_start_veh9 = [397.7299032 754.9801607 2.0227678]
x0_vehiclepos_park_veh9 = [330.3068 737.9526 3.051055]
x0_vehiclepos_start_veh10 = [411.3010347 761.3496809 1.996666]
x0_vehiclepos_park_veh10 = [335.6765 742.4433 3.051055]
current_raceline = "LVMS_GPS.csv"