% Simulink data dictionary TrajectoryPlanningEmulation.sldd
% references modelconfig.sldd
% references TUM_interfaces.sldd
% references raceline.sldd
% references vehicleparameter.sldd

P_PX2_EnterIdle_mps = Simulink.Parameter(2)
ActivateTP_PX2 = Simulink.Parameter(true, DataType="boolean")
P_PX2_VirtualDelay_s = Simulink.Parameter(0.032)
P_VDC_AccLimits_v_mps = Simulink.Parameter([0 20 30 40 50 60 70 80])
P_TP_dist_foresight_perf_s = Simulink.Parameter(4.5)
P_VDC_SafetyDistance_m = Simulink.Parameter(1)

ltpl_log = struct(
  s_global_m=[0; 5; 10; 15; 20; 25; 30; 35; 40; 45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 3000],
  debug_slow_tartraj_x_m=[0 5.102041 10.20408 15.30612 20.40816 25.5102 30.61224 35.71429 40.81633 45.91837 51.02041 56.12245 61.22449 66.32653 71.42857 76.53061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
   5 10.10204 15.20408 20.30612 25.40816 30.5102 35.61224 40.71429 45.81633 50.91837 56.02041 61.12245 66.22449 71.32653 76.42857 81.53061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
   10 15.10204 20.20408 25.30612 30.40816 35.5102 40.61224 45.71429 50.81633 55.91837 61.02041 66.12245 71.22449 76.32653 81.42857 86.53061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
   15 20.10204 25.20408 30.30612 35.40816 40.5102 45.61224 50.71429 55.81633 60.91837 66.02041 71.12245 76.22449 81.32653 86.42857 91.53061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
   20 25.10204 30.20408 35.30612 40.40816 45.5102 50.61224 55.71429 60.81633 65.91837 71.02041 76.12245 81.22449 86.32653 91.42857 96.53061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
   25 30.10204 35.20408 40.30612 45.40816 50.5102 55.61224 60.71429 65.81633 70.91837 76.02041 81.12245 86.22449 91.32653 96.42857 101.5306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
   30 35.10204 40.20408 45.30612 50.40816 55.5102 60.61224 65.71429 70.81633 75.91837 81.02041 86.12245 91.22449 96.32653 101.4286 106.5306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
   35 40.10204 45.20408 50.30612 55.40816 60.5102 65.61224 70.71429 75.81633 80.91837 86.02041 91.12245 96.22449 101.3265 106.4286 111.5306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
   40 45.10204 50.20408 55.30612 60.40816 65.5102 70.61224 75.71429 80.81633 85.91837 91.02041 96.12245 101.2245 106.3265 111.4286 116.5306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
   45 50.10204 55.20408 60.30612 65.40816 70.5102 75.61224 80.71429 85.81633 90.91837 96.02041 101.1224 106.2245 111.3265 116.4286 121.5306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   ],
  debug_slow_tartraj_y_m=[0 0 0 0 0 0 0 0 0 0 0 0 0 0 0 0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
   0 0 0 0 0 0 0 0 0 0 0 0 0 0 0 0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
   0 0 0 0 0 0 0 0 0 0 0 0 0 0 0 0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
   0 0 0 0 0 0 0 0 0 0 0 0 0 0 0 0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
   0 0 0 0 0 0 0 0 0 0 0 0 0 0 0 0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
   0 0 0 0 0 0 0 0 0 0 0 0 0 0 0 0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
   0 0 0 0 0 0 0 0 0 0 0 0 0 0 0 0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
   0 0 0 0 0 0 0 0 0 0 0 0 0 0 0 0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
   0 0 0 0 0 0 0 0 0 0 0 0 0 0 0 0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
   0 0 0 0 0 0 0 0 0 0 0 0 0 0 0 0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   ],
  debug_slow_tartraj_psi_rad=[-1.570796 -1.570796 -1.570796 -1.570796 -1.570796 -1.570796 -1.570796 -1.570796 -1.570796 -1.570796 -1.570796 -1.570796 -1.570796 -1.570796 -1.570796 -1.570796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
   -1.570796 -1.570796 -1.570796 -1.570796 -1.570796 -1.570796 -1.570796 -1.570796 -1.570796 -1.570796 -1.570796 -1.570796 -1.570796 -1.570796 -1.570796 -1.570796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
   -1.570796 -1.570796 -1.570796 -1.570796 -1.570796 -1.570796 -1.570796 -1.570796 -1.570796 -1.570796 -1.570796 -1.570796 -1.570796 -1.570796 -1.570796 -1.570796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
   -1.570796 -1.570796 -1.570796 -1.570796 -1.570796 -1.570796 -1.570796 -1.570796 -1.570796 -1.570796 -1.570796 -1.570796 -1.570796 -1.570796 -1.570796 -1.570796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
   -1.570796 -1.570796 -1.570796 -1.570796 -1.570796 -1.570796 -1.570796 -1.570796 -1.570796 -1.570796 -1.570796 -1.570796 -1.570796 -1.570796 -1.570796 -1.570796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
   -1.570796 -1.570796 -1.570796 -1.570796 -1.570796 -1.570796 -1.570796 -1.570796 -1.570796 -1.570796 -1.570796 -1.570796 -1.570796 -1.570796 -1.570796 -1.570796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
   -1.570796 -1.570796 -1.570796 -1.570796 -1.570796 -1.570796 -1.570796 -1.570796 -1.570796 -1.570796 -1.570796 -1.570796 -1.570796 -1.570796 -1.570796 -1.570796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
   -1.570796 -1.570796 -1.570796 -1.570796 -1.570796 -1.570796 -1.570796 -1.570796 -1.570796 -1.570796 -1.570796 -1.570796 -1.570796 -1.570796 -1.570796 -1.570796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
   -1.570796 -1.570796 -1.570796 -1.570796 -1.570796 -1.570796 -1.570796 -1.570796 -1.570796 -1.570796 -1.570796 -1.570796 -1.570796 -1.570796 -1.570796 -1.570796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
   -1.570796 -1.570796 -1.570796 -1.570796 -1.570796 -1.570796 -1.570796 -1.570796 -1.570796 -1.570796 -1.570796 -1.570796 -1.570796 -1.570796 -1.570796 -1.570796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   ],
  debug_slow_tartraj_kappa_radpm=[0 0 0 0 0 0 0 0 0 0 0 0 0 0 0 0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
   0 0 0 0 0 0 0 0 0 0 0 0 0 0 0 0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
   0 0 0 0 0 0 0 0 0 0 0 0 0 0 0 0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
   0 0 0 0 0 0 0 0 0 0 0 0 0 0 0 0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
   0 0 0 0 0 0 0 0 0 0 0 0 0 0 0 0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
   0 0 0 0 0 0 0 0 0 0 0 0 0 0 0 0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
   0 0 0 0 0 0 0 0 0 0 0 0 0 0 0 0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
   0 0 0 0 0 0 0 0 0 0 0 0 0 0 0 0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
   0 0 0 0 0 0 0 0 0 0 0 0 0 0 0 0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
   0 0 0 0 0 0 0 0 0 0 0 0 0 0 0 0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   ],
  debug_slow_tartraj_v_mps=repmat(50, 601, 50),
  debug_slow_tartraj_ax_mps2=repmat(0, 601, 50),
  debug_slow_tartraj_s_loc_m=[0 5.102041 10.20408 15.30612 20.40816 25.5102 30.61224 35.71429 40.81633 45.91837 51.02041 56.12245 61.22449 66.32653 71.42857 76.53061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
   0 5.102041 10.20408 15.30612 20.40816 25.5102 30.61224 35.71429 40.81633 45.91837 51.02041 56.12245 61.22449 66.32653 71.42857 76.53061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
   0 5.102041 10.20408 15.30612 20.40816 25.5102 30.61224 35.71429 40.81633 45.91837 51.02041 56.12245 61.22449 66.32653 71.42857 76.53061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
   0 5.102041 10.20408 15.30612 20.40816 25.5102 30.61224 35.71429 40.81633 45.91837 51.02041 56.12245 61.22449 66.32653 71.42857 76.53061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
   0 5.102041 10.20408 15.30612 20.40816 25.5102 30.61224 35.71429 40.81633 45.91837 51.02041 56.12245 61.22449 66.32653 71.42857 76.53061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
   0 5.102041 10.20408 15.30612 20.40816 25.5102 30.61224 35.71429 40.81633 45.91837 51.02041 56.12245 61.22449 66.32653 71.42857 76.53061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
   0 5.102041 10.20408 15.30612 20.40816 25.5102 30.61224 35.71429 40.81633 45.91837 51.02041 56.12245 61.22449 66.32653 71.42857 76.53061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
   0 5.102041 10.20408 15.30612 20.40816 25.5102 30.61224 35.71429 40.81633 45.91837 51.02041 56.12245 61.22449 66.32653 71.42857 76.53061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
   0 5.102041 10.20408 15.30612 20.40816 25.5102 30.61224 35.71429 40.81633 45.91837 51.02041 56.12245 61.22449 66.32653 71.42857 76.53061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
   0 5.102041 10.20408 15.30612 20.40816 25.5102 30.61224 35.71429 40.81633 45.91837 51.02041 56.12245 61.22449 66.32653 71.42857 76.53061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   ],
  debug_slow_tartraj_LapCnt=repmat(1, 601, 1),
  debug_slow_tartraj_ax_lim_mps2=repmat(18, 601, 50),
  debug_slow_tartraj_ay_lim_mps2=repmat(18, 601, 50),
  debug_slow_tartraj_banking_rad=repmat(0, 601, 50))

P_VDC_AccLimits_ax_mps2 = Simulink.Parameter([6 6 7 8 9 10 11 11])
P_VDC_AccLimits_ay_mps2 = Simulink.Parameter([18 18 21 24 28 31 36 40])
P_VDC_VirtualScaleFactor = Simulink.Parameter(0.6)
P_VDC_TrajEmulation_mode = 0